# Grasshopper definition graph_rebuilder.gh (Grasshopper 0.9.76)
# plug-ins: Python Interpreter

py_curr_dir = PythonScript(in_name="simmary.csv")  # -> out, gh_file, gh_dir, out_file
# ---------- py_curr_dir: Python ----------
gh_file = ghenv.Component.OnPingDocument().FilePath

gh_l = len( gh_file.split('\\')[-1] )

gh_dir = gh_file[:-gh_l]
print(gh_file, gh_dir)
out_file = gh_dir + in_name
# ---------- end py_curr_dir ----------
current_dir_files = Panel([py_curr_dir.gh_file, py_curr_dir.gh_dir, py_curr_dir.out_file])

py_curr_dir_2 = PythonScript(in_name="edge_output.txt")  # -> out, gh_file, gh_dir, out_file; same code as py_curr_dir
current_dir_files_2 = Panel([py_curr_dir_2.gh_file, py_curr_dir_2.gh_dir, py_curr_dir_2.out_file])

file = ReadFile(File=py_curr_dir.out_file, PerLineParse=True)
panel = Panel(file)
python = PythonScript(x=file)  # -> out, graft(a)
# ---------- python: Python ----------
x1 = eval(x)
a = x1[1]
print(a)
# ---------- end python ----------
file_2 = ReadFile(File=py_curr_dir_2.out_file, PerLineParse=True)
panel_2 = Panel(python.a)
edge_data = Panel(file_2)
python_2 = PythonScript(data=file_2)  # -> out, x1, y1, z1, x2, y2, z2, rad
# ---------- python_2: Python ----------
d = eval(data)

print(d[4])

x1 = []
y1 = []
z1 = []
x2 = []
y2 = []
z2 = []
rad = []

for n, i in enumerate(d):
    x1.append(i[0][0])
    y1.append(i[0][1])
    z1.append(i[0][2])
    x2.append(i[1][0])
    y2.append(i[1][1])
    z2.append(i[1][2])
    rad.append(i[2])
# ---------- end python_2 ----------
sort = SortList(Keys=python_2.rad)  # -> Keys, ValuesA
data = Data(graft(python_2.rad))
lng = ListLength(List=sort.Keys)
panel_3 = Panel(data)
pt = ConstructPoint(XCoordinate=python_2.x1, YCoordinate=python_2.y1, ZCoordinate=python_2.z1)
pt_2 = ConstructPoint(XCoordinate=python_2.x2, YCoordinate=python_2.y2, ZCoordinate=python_2.z2)
item = ListItem(List=sort.Keys, Index=expr("-1", lng), Wrap=True)
item_2 = ListItem(List=sort.Keys, Index=0, Wrap=True)
ln = Line(StartPoint=pt, EndPoint=pt_2)
dom = ConstructDomain(DomainStart=item_2, DomainEnd=item)
multiplication = Multiplication(A=python_2.rad, B=Slider(1, range=0..1))
remap = RemapNumbers(Value=python_2.rad, Source=dom, Target=Domain(0, 255))  # -> Mapped, Clipped
rgb = ColourRGB(Alpha=255, Red=remap.Mapped, Green=remap.Mapped, Blue=remap.Mapped)

# ---- group: Pipe Size
pipe_size = QuickGraph(python_2.rad)
pipe = Pipe(Curve=ln, Radius=multiplication, Caps=0)  # -> flatten(Pipe)
preview = CustomPreview(Geometry=pipe, Shader=rgb)

# ----
bang = ExplodeTree(Data=panel_2)  # -> _0000, _0001, _0002

# ---- group: Bar Size Record
data_2 = Data(panel_3)
rec = DataRecorder(data_2, DataLimit=-10, RecordData=True)
raidus_record = Panel(rec)
graph = QuickGraph(raidus_record)

# ----
python_3 = PythonScript(x=bang._0000)  # -> out, a
# ---------- python_3: Python ----------
a = ((float(x)-1.489307)/1000)

print(a)
# ---------- end python_3 ----------

# ---- group: stress
rec_2 = DataRecorder(bang._0002, DataLimit=-10, RecordData=True)
stress = Panel(rec_2)
graph_2 = QuickGraph(stress)

# ---- group: displacement
rec_3 = DataRecorder(bang._0001, DataLimit=-10, RecordData=True)
displacement = Panel(rec_3)
graph_3 = QuickGraph(displacement)

# ---- group: mass,
rec_4 = DataRecorder(python_3.a, DataLimit=-10, RecordData=True)
mass = Panel(rec_4)
graph_4 = QuickGraph(mass)
